# Grasshopper definition 3d_L-systemGenerator.gh (Grasshopper 1.0.7)
# plug-ins: Rabbit, Fattener, DendroGH

# ----
# 'F' RULES
# Curvy Line Patterns
# Cosmic Spiral
# Mystical Pattern
# Branching Tree
# Quantum Tree
# Labyrnth
panel = Panel("F=FF-F++F-F")
panel_2 = Panel("F=FF-[F]+F[F]-F-FF")
panel_3 = Panel("F=F+jF/F")
panel_4 = Panel("F=F+\"FJ+[F-F]-F-F[F]-[J+F]F\"")
panel_5 = Panel("F=F[+F]F[-F]F-J/F+J")
panel_6 = Panel("F=F-F+F/F")

# ----
# AXIOMS
panel_7 = Panel("F")
# The following symbols drive the Turtle:
# (A/B/C/D.. placeholders, used to nest other symbols)
# F move forward at distance L(Step Length)
# f move forward at distance L(Step Length)
#  w/o drawing a line
# + turn left A(Default Angle) degrees
# – turn right A(Default Angle) degrees
# \ roll left A(Default Angle) degrees
# / roll right A(Default Angle) degrees
# ^ pitch up A(Default Angle) degrees
# & pitch down A(Default Angle) degrees
# | turn around 180 degrees
# J insert point at this position
# “ multiply current length by dL(Length Scale)
# ! multiply current thickness by dT(Thickness Scale)
# [ start a branch(push turtle state)
# ] end a branch(pop turtle state)
panel_8 = Panel("FFAF")
panel_9 = Panel("ABA")
# RULES
panel_10 = Panel("\"FJ[F]F")

# ----
# FUTURE GOALS
# Weaving Patterns
panel_11 = Panel("A=&[B]//[B]////B")
panel_12 = Panel("A=B\"\"FB")
text = Text("B=B&F&FJB")
text_2 = Text("A=\"\"[B]//[A]////B")

# ----
# 'J' RULES
# Labyrnth
# Intricate Weave
panel_13 = Panel("J=F+J[F+F]F/F-F")
panel_14 = Panel("J=F+J-FJ/FJ/FJ+[F]+J-FJ")

# ----
# Mapping Surface Configuration
# Surface Division Planes
# Primitive Shapes
radius = Slider(20, range=0..100)
X = Slider(0, range=0..50)
Y = Slider(0, range=0..100)
Z = Slider(0, range=0..100)
height = Slider(18, range=0..100)
pt = ConstructPoint(XCoordinate=X, YCoordinate=Y, ZCoordinate=Z)
xy = XYPlane(Origin=pt)
cyl = Cylinder(Base=xy, Radius=radius, Length=height)
sph = Sphere(Base=xy, Radius=radius)
cap = CapHoles(Brep=cyl)
mesh = MeshBrep(
    Brep=sph,
    Settings={GridMaxCount=0, GridMinCount=16, JaggedSeams=False, MaxEdgeLength=0, MinEdgeLength=0.0001, MinTolerance=0, Refine=True, RefineAngle=0, RelativeTolerance=0.65, SimplePlanes=True, Tolerance=0})
v_count = Slider(20, range=0..100)
u_count = Slider(16, range=0..100)
debrep = DeconstructBrep(Brep=sph)  # -> Faces, Edges, Vertices
sframes = SurfaceFrames(Surface=debrep.Faces, UCount=u_count, VCount=v_count)  # -> flatten(Frames), Parameters

axiom = Text("FJF")

# ----
# FUTURE GOALS
# 
# WEAVERBIRD SURFACE MANIPULATION
# Tube Thickness
# End Cap Type
# 0=None(open), 1=Pinched, 2=Capped, 3=Spikes
thickness = Slider(0.44, range=0..10)
endtype = Slider(3, range=0..10)
join = JoinCurves(Preserve=False)
F = Fatten(Skeleton=join, Thickness=thickness, LengthSubdivisions=0, EndType=endtype, AdjustForAngle=False)
growth_factor = Slider(1, range=1..3)

text_3 = Text("F=F+F[+F]F[-F]F/J")
text_4 = Text(panel_13)

# ----
# L-System + Turtle Implementation
# --> TURTLE PARAMs
# Step length
# --> L-SYSTEM PARAMs
# Step scale
# Rotation angle
iterations = Slider(3, range=0..10)
lsystem = LSystem(Axiom=axiom, ProductionRules=[text_4, text_3], NumberOfGenerations=iterations)  # -> Word, ListOfWords, LSystem
angle = Slider(45.98, range=0..100)
scale = Slider(1.2, range=0..2)
step = Slider(1.32, range=0..10)
turtle = Turtle(
    SourceString=lsystem.Word,
    StepLength=step,
    StepLengthScale=scale,
    Angle=angle,
    AngleScale=0.9,
    InitialPositionAndOrientation=sframes.Frames)  # -> Edges, Vertices, TubeGeometry, Planes, SectionProfiles

join_2 = JoinCurves(Curves=turtle.Edges, Preserve=False)  # -> flatten(Curves)

# ----
# Volumetric modeling of L-system geometry
# --> Turtle curves
# Smoothing Settings
# 'Resolution' Setting
# Unified mesh -->
# --> Surface mesh
voxel_size = Slider(0.12, range=0..2)
curve_radius = Slider(2, range=0..10)
vsettings = CreateSettings(VoxelSize=voxel_size, Bandwidth=1, Isovalue=0, Adaptivity=0.1)
vmesh = MeshToVolume(Mesh=mesh, Settings=vsettings)
vcurve = CurveToVolume(Curves=join_2, CurveRadius=curve_radius, Settings=vsettings)
vunion = VolumeUnion(Volumes=[vcurve, vmesh])
type = Slider(1, range=0..3)
iterations_2 = Slider(4, range=0..10)
voxel_size_2 = Slider(1.75, range=0..2)
vsmooth = SmoothVolume(Volume=vunion, Width=1, Type=type, Iterations=iterations_2)
vsettings_2 = CreateSettings(VoxelSize=voxel_size_2, Bandwidth=1, Isovalue=0, Adaptivity=0.1)
mvolume = VolumeToMesh(Volume=vsmooth, VolumeSettings=vsettings_2)
preview = CustomPreview(
    Geometry=mvolume,
    Material={diffuse=RGB(221, 160, 221), emission=RGB(66, 48, 66), shine=0.5, specular=RGB(255, 255, 255), transparency=0})
