# Grasshopper definition LA3_basicSlicerFor3dPrinting.gh (Grasshopper 1.0.7)
# plug-ins: BullAnt, Pancake

build_plate_mid_point = Slider(105, range=0..130)
radius = Slider(10, range=0..85)
build_plate_middle = VectorXYZ(XComponent=build_plate_mid_point, YComponent=build_plate_mid_point, ZComponent=0)  # -> Vector, Length
# Closed Cylinder Build
object_height = Slider(3, range=0..60)
circle = Circle(Plane=PlaneXY(0, 0, 0), Radius=radius)
move = Move(Geometry=circle, Motion=build_plate_middle.Vector)  # -> Geometry, Transform
unit_z = UnitZ(Factor=object_height)
Z = Slider(1, range=0..1)
extrude = Extrude(Base=move.Geometry, Direction=unit_z)
layer_height = Slider(0.3, range=0..1)
area = Area(Geometry=move.Geometry)  # -> Area, Centroid
unit_z_2 = UnitZ(Factor=Z)
cap_holes = CapHoles(Brep=extrude)
closed_cylinder = Geometry(cap_holes)
contour = Contour(Shape=closed_cylinder, Point=area.Centroid, Direction=unit_z_2, Distance=layer_height)
trim_tree = TrimTree(Tree=contour, Depth=1)
boundary_srfs = BoundarySurfaces(Edges=trim_tree)
bounding_box = BoundingBox(Content=trim_tree, Plane=PlaneXY(0, 0, 0))  # -> Box, Box_2
nozzle_diameter = Slider(0.4, range=0..2)
extrusion_factor = Slider(1.2, range=0..10)
# Sliding Infill Density Value
infill_density_percentage = Slider(100, range=10..100, expression="x/100")
box_corners = BoxCorners(Box=bounding_box.Box_2)  # -> CornerA, CornerB, CornerC, CornerD, CornerE, CornerF, CornerG, CornerH
deconstruct_box = DeconstructBox(Box=bounding_box.Box)  # -> Plane, X, Y, Z
extrusion_width = Multiplication(A=nozzle_diameter, B=extrusion_factor)
list_item = ListItem(List=box_corners.CornerB, Index="0", Wrap=True)
list_item_2 = ListItem(List=box_corners.CornerA, Index="0", Wrap=True)
division = Division(A=extrusion_width, B=infill_density_percentage)
deconstruct = Deconstruct(Point=list_item)  # -> XComponent, YComponent, ZComponent
deconstruct_2 = Deconstruct(Point=list_item_2)  # -> XComponent, YComponent, ZComponent
# Infill Lines
subtraction = Subtraction(A=deconstruct.XComponent, B=deconstruct_2.XComponent)
unit_x = UnitX(Factor=division)
division_2 = Division(A=subtraction, B=division)
deconstruct_domain = DeconstructDomain(Domain=deconstruct_box.X)  # -> Start, End
deconstruct_domain_2 = DeconstructDomain(Domain=deconstruct_box.Y)  # -> Start, End
deconstruct_domain_3 = DeconstructDomain(Domain=deconstruct_box.Z)  # -> Start, End
round = Round(Number=division_2)  # -> Nearest, Floor, Ceiling
construct_point = ConstructPoint(XCoordinate=deconstruct_domain.Start, YCoordinate=deconstruct_domain_2.Start, ZCoordinate=deconstruct_domain_3.Start)
construct_point_2 = ConstructPoint(XCoordinate=deconstruct_domain.Start, YCoordinate=deconstruct_domain_2.End, ZCoordinate=deconstruct_domain_3.End)
line = Line(StartPoint=construct_point, EndPoint=construct_point_2)
linear_array = LinearArray(Geometry=line, Direction=unit_x, Count=round.Ceiling)  # -> Geometry, Transform
trim_tree_2 = TrimTree(Tree=linear_array.Geometry, Depth=1)
scale_factor = Slider(1.1, range=0..2)
scale_nu = ScaleNU(Geometry=trim_tree_2, Plane=area.Centroid, ScaleX=1, ScaleY=scale_factor, ScaleZ=1)  # -> Geometry, Transform
brep_line = BrepLine(Brep=boundary_srfs, Line=graft(scale_nu.Geometry), LimitToFirst=False, UseTasks=True)  # -> simplify(Curves), Points
segment_length = Slider(0.1, range=0..1)
# Line Segments
merge = Merge(Data1=brep_line.Curves, Data2=trim_tree)  # -> flatten(Result)
divide_length = DivideLength(Curve=merge, Length=segment_length)  # -> Points, Tangents, Parameters
boolean = Slider(1, range=0..1)
polyline = PolyLine(Vertices=divide_length.Points, Closed=boolean)
ggsimplifypolyline = GgSimplifyPolyline(Polyline=polyline, Tol=0.001)  # -> flatten(Polyline)
extrusion_factor_2 = Slider(1.2, range=0..10)
# Task 2:
# 
# Gcode Generator
nozzle_diameter_2 = Slider(0.4, range=0..1)
explode = Explode(Curve=ggsimplifypolyline, Recursive=True)  # -> Segments, Vertices
layer_height_2 = Slider(0.3, range=0..1)
extrusion_rate = Panel("300")
travel_rate = Panel("1000")
extrusion_width_2 = Multiplication(A=extrusion_factor_2, B=nozzle_diameter_2)
param_viewer = ParamViewer(explode.Segments)
line_2 = Line(flatten(explode.Segments))
ghpython_script = GhPythonScript(
    lines=line_2,
    travelFeedRate=travel_rate,
    extrusionFeedRate=extrusion_rate,
    layerHeight=layer_height_2,
    extrusionWidth=extrusion_width_2)  # -> out, gCodeOutput; inputs lines: list of Line
# ---------- ghpython_script: Python ----------
"""Provides a scripting component.
    # Parameter Inputs:
        # travelFeedRate: travel feed rate for the printer (in millimeters/minute)
        # extrusionFeedRate: extrusion feed rate for the printer nozzle (in millimeters/minute)
        # layerHeight: layer height variable (in millimeters)
        # extrusionWidth: extrusion width variable (in millimeters)

    Output:
        gCodeOutput: The output gcode"""

__author__ = "joshp"
__version__ = "2023.10.30"

import rhinoscriptsyntax as rs
import math

# Gcode Commands
cmdMove = "G1"

#Gcode param names
paramX = "X"
paramY = "Y"
paramZ = "Z"
paramE = "E"
paramF = "F"

# separate params in a cmd 
paramDelimiter = " "

# Separate commands
cmdDelimiter = "\n"

#Formatter for param values
numFormat = "{value:.3f}"

def is_equal_float(f1, f2, epsilon=0.0001):
    return math.fabs(f2 - f1) <= epsilon

def is_same_point(pt1, pt2):
    """
    Returns true if all coordinates are at the same point
    """
    return is_equal_float(pt1[0],pt2[0]) and is_equal_float(pt1[1],pt2[1]) and is_equal_float(pt1[2],pt2[2])

def gcode_move(currPos, nextPos, feedRate=None, shouldExtrude=False):
    """
    Creates a string composed of G1 move command and any associated parameters"""
    params = [cmdMove]

    # Compare X positions
    if currPos[0] != nextPos[0]:
        xString = paramX + numFormat.format(value=nextPos[0])
        params.append(xString)

    # Compare Y positions
    if currPos[1] != nextPos[1]:
        yString = paramY + numFormat.format(value=nextPos[1])
        params.append(yString)
        
    # Compare Z positions
    if(nextPos[2] < 0.3):
            nextPos[2] = 0.3
    if currPos[2] != nextPos[2]:
        zString = paramZ + numFormat.format(value=nextPos[2])
        params.append(zString)
        
    # Add feed rate if provided
    if feedRate is not None:
        feedRateString = paramF + numFormat.format(value=feedRate)
        params.append(feedRateString)
        
    # Calculate 'E' if extrusion is required
    if shouldExtrude:
        extrusionValue = calculate_e(currPos, nextPos)
        # Format 'E' value
        paramEvalue = paramE + numFormat.format(value=extrusionValue)
        # Append the extrusion value 'E'
        params.append(paramEvalue)
                
    # Combine parameters into a G-code command
    moveCmd = " ".join(params)
    moveCmd = moveCmd.strip(" ")
    return moveCmd

def calculate_e(prevPos, nextPos):
    """
    Calculates the volume of filament required for a move between two points.
    Returns the extrusion value, 'E'.
    """
    # Distance between the two points
    distance = rs.Distance(prevPos, nextPos)

    # Area of the cross-section along the extrusion path
    crossSectionArea = extrusionWidth * layerHeight
        
    # Volume of filament required for this move
    volumeOut = crossSectionArea * distance

    return volumeOut

# Main

# Printer Origin Point
origin = [0, 0, 0]
prevPos = origin

gcodeLines = []

# Now move along the line segments
for i in range(0,len(lines)):
    # Get line segment points
    line = lines[i]
    lineStartPt = line[0]
    lineEndPt = line[1]
    
    # Sets first layer Z coordinates to layer height
    if (i==0 & int(lineStartPt[2])<0.3):
        # case for transition move to second layer
        if(lineStartPt[2] == lineEndPt[2]):
            lineStartPt[2] = 0.3
            lineEndPt[2] = 0.3
    
    if not is_same_point(prevPos,lineStartPt):
        # first move from origin to starting point
        firstMove = gcode_move(prevPos, lineStartPt, feedRate=travelFeedRate)
        gcodeLines.append(firstMove)
    
    # Move alone line segment
    traverseLine = gcode_move(lineStartPt, lineEndPt, feedRate=travelFeedRate, shouldExtrude=True)
    
    # Append move
    gcodeLines.append(traverseLine)
    
    # update previous position to be end of line segment
    prevPos = lineEndPt

#### WARNING: DO NOT EDIT THE START GCODE! #####
start_gcode_lines = [";START GCODE",
    "M73 P0 R42",
    "M73 Q0 S43",
    "M201 X1000 Y1000 Z200 E5000 ; sets maximum accelerations, mm/sec^2",
    "M203 X200 Y200 Z12 E120 ; sets maximum feedrates, mm / sec",
    "M204 S1250 T1250 ; sets acceleration (S) and retract acceleration (R), mm/sec^2",
    "M205 X8.00 Y8.00 Z0.40 E4.50 ; sets the jerk limits, mm/sec",
    "M205 S0 T0 ; sets the minimum extruding and travel feed rate, mm/sec",
    ";TYPE:Custom",
    "M862.3 P \"MK3S\" ; printer model check",
    "M862.1 P0.4 ; nozzle diameter check",
    "M115 U3.13.1 ; tell printer latest fw version",
    "G90 ; use absolute coordinates",
    "M83 ; extruder relative mode",
    "M104 S215 ; set extruder temp",
    "M140 S60 ; set bed temp",
    "M190 S60 ; wait for bed temp",
    "M109 S215 ; wait for extruder temp",
    "G28 W ; home all without mesh bed level",
    "G80 ; mesh bed leveling",
    "G1 Z0.2 F720",
    "G1 Y-3 F1000 ; go outside print area",
    "G92 E0",
    "G1 X60 E9 F1000 ; intro line",
    "G1 X100 E12.5 F1000 ; intro line",
    "G92 E0",
    "M221 S95",
    "; Don't change E values below. Excessive value can damage the printer.",
    "M907 E538 ; set extruder motor current",
    "G21 ; set units to millimeters",
    "G90 ; use absolute coordinates",
    "M83 ; use relative distances for extrusion",
    "M900 K0.05 ; Filament gcode LA 1.5",
    "M900 K30 ; Filament gcode LA 1.0",
    "M107"]
    
##### WARNING: DO NOT EDIT THE END GCODE! ######
end_gcode_lines = ["; END Gcode", 
    "M204 S1000", 
    "M107", 
    ";TYPE:Custom", 
    "; Filament-specific end gcode", 
    "G1 Z100 F720 ; Move print head further up", 
    "G1 X0 Y200 F3600 ; park", 
    "G4 ; wait",
    "M221 S100 ; reset flow",
    "M900 K0 ; reset LA",
    "M104 S0 ; turn off temperature",
    "M140 S0 ; turn off heatbed",
    "M107 ; turn off fan",
    "M84 ; disable motors"]
    
# Combine Lines - DO NOT EDIT
# These lines will put the start gcode before your gcode, and the end gcode
# after then merge them into the gcode output using a COMMAND_DELIMETER = “\n”
gcodeLines = start_gcode_lines + gcodeLines + end_gcode_lines
gCodeOutput = cmdDelimiter.join(gcodeLines)
print(gCodeOutput)
# ---------- end ghpython_script ----------
panel = Panel(explode.Segments)
panel_2 = Panel("/Users/joshp/compfab-2023-fall/assignments/LA3/gCodeOutput/output.gcode")
panel_3 = Panel(ghpython_script.gCodeOutput)
true_only_button = TrueOnlyButton(LastSaveLocalization="neutral,N")
# Gcode export
export_txt = ExportTXT(
    Content=ghpython_script.gCodeOutput,
    FileLocation=panel_2,
    Overwrite=Toggle(True),
    Encoding="utf-8",
    Export=true_only_button,
    LastSaveLocalization="neutral,N")
