# Grasshopper definition gCode_IntroDemo.gh (Grasshopper 1.0.7)

Y = Slider(1, range=0..500)
X = Slider(25, range=0..500)
Z = Slider(0, range=0..500)
Y_2 = Slider(1, range=0..500)
X_2 = Slider(4, range=0..500)
Z_2 = Slider(0, range=0..500)
construct_point = ConstructPoint(XCoordinate=Slider(4, range=-10..30), YCoordinate=Slider(10, range=-10..30), ZCoordinate=Slider(1, range=-10..30))
construct_point_2 = ConstructPoint(XCoordinate=Slider(25, range=-10..30), YCoordinate=Slider(10, range=-10..30), ZCoordinate=Slider(1, range=-10..30))
travel_rate = Panel("1000")
extrusion_rate = Panel("600")
construct_point_3 = ConstructPoint(XCoordinate=X_2, YCoordinate=Y_2, ZCoordinate=Z_2)
construct_point_4 = ConstructPoint(XCoordinate=X, YCoordinate=Y, ZCoordinate=Z)
line = Line(StartPoint=construct_point, EndPoint=construct_point_2)
line_2 = Line(StartPoint=construct_point_3, EndPoint=construct_point_4)
line_3 = Line(flatten([line, line_2]))
panel = Panel(line_3)
ghpython_script = GhPythonScript(lines=line_3, travelFeedRate=travel_rate, extrusionFeedRate=extrusion_rate)  # -> out, gCodeOutput; inputs lines: list of Line
# ---------- ghpython_script: Python ----------
__author__ = "joshp"
__version__ = "2023.10.30"

import rhinoscriptsyntax as rs

# Gcode Commands

cmdMove = "G1"

#Gcode param names
paramX = "X"
paramY = "Y"
paramZ = "Z"
paramE = "E"
paramF = "F"

# separate params in a cmd 
paramDelimiter = " "

# Separate commands
cmdDelimiter = "\n"

#Formatter for param values
numFormat = "{value:.3f}"

# Parameters
extrusionWidth = 0.4  # Set desired extrusion width (in millimeters)
layerHeight = 0.2  # Set desired layer height (in millimeters)

def isSamePoint(pt1, pt2):
    """
    Returns true if all coordinates are at the same point
    """
    return (pt1[0] == pt2[0]) and (pt1[1] == pt2[1]) and (pt1[2] == pt2[2])


# func to create string composed of G1 move cmd 
# and any associated params
def gcodeMove(currPos, nextPos, feedRate=None, shouldExtrude=False):
    params = [cmdMove]

    # Compare X positions
    if currPos[0] != nextPos[0]:
        xString = paramX + numFormat.format(value=nextPos[0])
        params.append(xString)

    # Compare Y positions
    if currPos[1] != nextPos[1]:
        yString = paramY + numFormat.format(value=nextPos[1])
        params.append(yString)
        
    # Compare Z positions
    if currPos[2] != nextPos[2]:
        zString = paramZ + numFormat.format(value=nextPos[2])
        params.append(zString)
        
    # Add feed rate if provided
    if feedRate is not None:
        feedRateString = paramF + numFormat.format(value=feedRate)
        params.append(feedRateString)
        
    # Calculate 'E' if extrusion is required
    if shouldExtrude:
        extrusionValue = calculateE(currPos, nextPos)
        # Format 'E' value
        paramEvalue = paramE + numFormat.format(value=extrusionValue)
        
        # Append the extrusion value 'E'
        params.append(paramEvalue)
                
    # Combine parameters into a G-code command
    moveCmd = " ".join(params)
    moveCmd = moveCmd.strip(" ")
    return moveCmd

# case for extrude
# boolean shouldExtrude = True

# E Calculation function
    # calculate the distance between two points
    
    # Use extrusion width and layer height to 
    # calculate the area of cross section along extrusion path
    
    # Then use the distance and area to calculate the Volume out
    
    # Solve for "E", length of filament using the 'Volume in = Volume out' 

# Function to calculate the extrusion value 'E'
def calculateE(prevPos, nextPos):
    # Calculate the distance between two points
    distance = rs.Distance(prevPos, nextPos)

    # Calculate the area of the cross-section along the extrusion path
    crossSectionArea = extrusionWidth * layerHeight
        
    # Calculate the volume of filament required for this move
    volumeOut = crossSectionArea * distance

    return volumeOut


# Main

line = lines[0]
# Check output, no need to index two levels
# line[0] = 10,10,1, not 5,1,0,30,1,0


print(lines)
origin = [0, 0, 0]

gCodeLines = []

prevPos = origin

# Now move to the line segments
for i in range(0, len(lines)):
    # Get pts of the line segment
    line = lines[i]
    lineStartPt = line[0]
    lineEndPt = line[1]
    print('Previous point: '+str(prevPos)+'\n'+'start point: '+str(lineEndPt))
    if not isSamePoint(prevPos,lineStartPt):
    
        # first move from origin to starting point
        firstMove = gcodeMove(prevPos, lineStartPt, feedRate=travelFeedRate)
        gCodeLines.append(firstMove)
    
    # Move alone line segment
    traverseLine = gcodeMove(lineStartPt, lineEndPt, feedRate=travelFeedRate, shouldExtrude=True)
    
    # Append move
    gCodeLines.append(traverseLine)
    
    # update previous position to be end of line segment
    prevPos = lineEndPt


gCodeOutput = cmdDelimiter.join([firstMove, traverseLine])
print(gCodeOutput)
# ---------- end ghpython_script ----------
panel_2 = Panel(ghpython_script.gCodeOutput)
